# Grasshopper definition Add_wall_depth_for_daylight_simulation.gh (Grasshopper 0.9.76)
# plug-ins: Python Interpreter

honeybee = Honeybee_Honeybee()  # -> Vviiiiiiiiiizzz; plug-in component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
ladybug = Ladybug_Ladybug()  # -> Vviiiiiiiiiizzz; plug-in component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
number_slider = Slider(4.2, range=0..10)
number_slider_2 = Slider(7, range=0..10)
# Convert the box to Honeybee zone
# All the material will be set to default
# In case you want to change them search
# for Honeybee_Set Radiance Materials
# component.
box = DomainBox(Base=PlaneXY(0, 0, 0), X=number_slider, Y=number_slider_2, Z=Slider(3.2, range=0..10))
mass2zone = Honeybee_Masses2Zones(zoneMasses=flatten(box), isConditioned=True, maxRoofAngle=30, createHBZones=Toggle(True))  # -> readMe, HBZones; plug-in component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
# Add glazing based on percentage
# In case you want to add custom windows
# use Honeybee_addHBGlz component.
glzparamlist = Honeybee_GlazingParametersList(northGlzParam=0, westGlzParam=0, southGlzParam=Slider(0.3, range=0..1), eastGlzParam=0)  # -> glzParamList; plug-in component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
panel = Panel("https://www.energyplus.net/weather-download/north_and_central_america_wmo_region_4/USA/PA/USA_PA_Philadelphia.Intl.AP.724080_TMY3/all")
epw_stat = Ladybug_OpenEPWAndSTATWeatherFiles(weatherFileURL=panel)  # -> epwFile, statFile; plug-in component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
glazingcreator = Honeybee_GlazingBasedOnRatio(HBObjects=mass2zone.HBZones, glzRatio=glzparamlist, runIt=Toggle(True))  # -> readMe, HBObjWGLZ; plug-in component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
pt = ConstructPoint(XCoordinate=number_slider, YCoordinate=expr("-x", number_slider_2), ZCoordinate=0)
pt_2 = ConstructPoint(XCoordinate=0, YCoordinate=0, ZCoordinate=0)

# ---- group: HB Zone With Glazing
brep = Brep(glazingcreator.HBObjWGLZ)

# ----
# Create ground in front of the room
# for more accurate analysis
rec_2pt = Rectangle2Pt(Plane=PlaneXY(0, 0, 0), PointA=pt_2, PointB=pt, Radius=0)  # -> Rectangle, Length
genclimatebasedsky = Honeybee_GenerateClimateBasedSky(weatherFile=epw_stat.epwFile, month="6", day="21", hour="9")  # -> radiationValues, skyFilePath; plug-in component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
genhbzonetestpts = Honeybee_GenerateZoneTestPoints(HBZone=brep, gridSize=Slider(0.5, range=0..1), distBaseSrf=Slider(0.762, range=0..1), moveTestMesh=Toggle(True))  # -> readMe, simplify(testPoints), simplify(ptsVectors), simplify(facesArea), simplify(mesh); plug-in component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
wires = BrepWireframe(Brep=brep, Density=-1)
boundary = BoundarySurfaces(Edges=rec_2pt.Rectangle)
wires_2 = BrepWireframe(Brep=boundary, Density=-1)

# ---- group: wall depth
number_slider_3 = Slider(0.3, range=0..1)

# ----
decomposebytype = Honeybee_DecomposeBasedOnType(HBZone=brep)  # -> walls, interiorWalls, airWalls, windows, interiorWindows, skylights, roofs, ceilings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; plug-in component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
# Add window thickness
edges = BrepEdges(Brep=decomposebytype.windows)  # -> Naked, Interior, NonManifold
evalsrf = EvaluateSurface(Surface=reparameterize(decomposebytype.windows), Point=".5,.5")  # -> Point, Normal, Frame
join = JoinCurves(Curves=edges.Naked, Preserve=False)
amp = Amplitude(Vector=evalsrf.Normal, Amplitude=number_slider_3)
extr = Extrude(Base=join, Direction=amp)
createhbsrfs = Honeybee_createHBSrfs(geometry=extr)  # -> readMe, simplify(HBSurface); plug-in component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

createhbsrfs_2 = Honeybee_createHBSrfs(geometry=boundary)  # -> readMe, simplify(HBSurface); plug-in component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
# Put the recipie together!
gridbasedsimulation = Honeybee_GridBasedSimulation(
    skyFile=genclimatebasedsky.skyFilePath,
    testPoints=genhbzonetestpts.testPoints,
    ptsVectors=genhbzonetestpts.ptsVectors,
    simulationType=0)  # -> analysisRecipe; plug-in component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
preview = CustomPreview(Geometry=createhbsrfs.HBSurface, Shader=ColourSwatch(SwatchColor=RGBA(211, 175, 255, 145)))
toggle = BooleanToggle(False)
# Run the analysis
rundaylightanalysis = Honeybee_RunDaylightSimulation(
    HBObjects=flatten([brep, createhbsrfs_2.HBSurface, createhbsrfs.HBSurface]),
    analysisRecipe=gridbasedsimulation,
    writeRad=toggle,
    runRad=toggle,
    overwriteResults=True)  # -> readMe, analysisType, resultsUnit, results, testPts, resultFiles, radGeoFile, studyFolder, done; plug-in component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
gradientlibrary = Ladybug_GradientLibrary(gradIndex=Slider(1, range=0..10))  # -> customColors; plug-in component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
legendpar = Ladybug_LegendParameters(
    lowBound=Slider(0, range=0..100),
    highBound=Slider(500, range=0..1000),
    numSegments=Slider(6, range=0..10),
    customColors=flatten(gradientlibrary))  # -> legendPar; plug-in component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

# ---- group: make it 3D!
dom = ConstructDomain(DomainStart=0, DomainEnd=Slider(1, range=0..1))

# ----
# Visualize the results
recolormesh = Ladybug_RecolorMesh(
    analysisResult=rundaylightanalysis.results,
    inputMesh=genhbzonetestpts.mesh,
    heightDomain=dom,
    legendPar=legendpar,
    analysisTitle=rundaylightanalysis.analysisType,
    legendTitle=rundaylightanalysis.resultsUnit)  # -> readMe, newMesh, newLegend, legendBasePt, meshColors, legendColors; plug-in component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
