# Grasshopper definition Create_3D_visualization_with_contour_curves_for_Ladybug_and_Honeybee.gh (Grasshopper 0.9.76)
# plug-ins: Python Interpreter

values_to_be_contour = Panel("""2
3
4
5
6
7
8""")
ladybug = Ladybug_Ladybug()  # -> Vviiiiiiiiiizzz; plug-in component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

# ---- group: range for zValues in 3D mesh in document units
panel = Panel("0")
panel_2 = Panel("5")

# ---- group: analysis results
num = Number([0, 0, 0, 0, 0, 0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])

# ---- group: Ladybug or Honeybee result mesh
mesh = Mesh(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)

# ----
bnd = Bounds(Numbers=num)
dom = ConstructDomain(DomainStart=panel, DomainEnd=panel_2)
panel_3 = Panel(bnd)

# ---- group: Create 3D Mesh
gradientlibrary = Ladybug_GradientLibrary(gradIndex="1")  # -> customColors; plug-in component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
legendpar = Ladybug_LegendParameters(customColors=flatten(gradientlibrary))  # -> legendPar; plug-in component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
# 3D Mesh
contourmesh = Ladybug_CountourMesh(
    analysisResult=num,
    inputMesh=mesh,
    heightDomain=dom,
    legendPar=legendpar,
    analysisTitle="sunlight hours",
    legendTitle="hours")  # -> readMe, contourMesh, underlayMesh, contourLines, contourColors, contourLabels, legend, legendBasePt, legendColors, intPlanes; plug-in component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
