# Grasshopper definition Filter_Hourly_Data_By_Analysis_Period.gh (Grasshopper 0.9.76)
# plug-ins: Python Interpreter

ladybug = Ladybug_Ladybug()  # -> Vviiiiiiiiiizzz; plug-in component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
panel = Panel("https://www.energyplus.net/weather-download/north_and_central_america_wmo_region_4/USA/MD/USA_MD_Baltimore-Washington.Intl.AP.724060_TMY3/all")
open_epw_stat = Ladybug_OpenEPWAndSTATWeatherFiles(weatherFileURL=panel)  # -> epwFile, statFile; plug-in component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
importepw = Ladybug_ImportEpw(epwFile=open_epw_stat.epwFile)  # -> readMe, latitude, location, dryBulbTemperature, dewPointTemperature, relativeHumidity, windSpeed, windDirection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; plug-in component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
analysisperiod = Ladybug_AnalysisPeriod(fromHour="9", toHour="15")  # -> readMe, analysisPeriod; plug-in component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
selectandaveragedata = Ladybug_AverageData(annualHourlyData=importepw.directNormalRadiation, analysisPeriod=analysisperiod.analysisPeriod)  # -> readMe, selHourlyData, averagedDaily, averagedMonthly, avrMonthlyPerHour, avrAnalysisPeriod; plug-in component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
_3dchart = Ladybug_3DChart(inputData=flatten(selectandaveragedata.selHourlyData))  # -> readMe, graphMesh, graphCurves, legend, legendBasePts, title, titleBasePts, dataPts, conditionalHOY; plug-in component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
