# Grasshopper definition Find_area_of_the_room_which_receives_less_than_1000_lux.gh (Grasshopper 0.9.76)

# ---- group: test geometry for visualization purpose
brep = Brep([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])
wires = BrepWireframe(Brep=brep, Density=-1)

# ---- group: results mesh
mesh = Mesh(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)

# ---- group: results
num = Number([326.56, 307.27, 278.95, 446.67, 463.43, 481.99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])

# ----
larger = LargerThan(FirstNumber=num, SecondNumber="1000")  # -> LargerThan, OrEqualTo
faceb = FaceBoundaries(Mesh=mesh)
cullf = CullFaces(Mesh=mesh, Pattern=larger.LargerThan)
area = Area(Geometry=mesh)  # -> Area, Centroid
area_2 = Area(Geometry=cullf)  # -> Area, Centroid
area_with_less_than_1000_lux = Panel(area_2.Area)
total_area = Panel(area.Area)
