# Grasshopper definition Find_when_sun_is_visible_to_a_point.gh (Grasshopper 0.9.76)
# plug-ins: Python Interpreter

number_slider = Slider(45, range=0..100)

panel = Panel("https://www.energyplus.net/weather-download/north_and_central_america_wmo_region_4/USA/PA/USA_PA_Philadelphia.Intl.AP.724080_TMY3/all")
# Generate Annual Sun Positions
epw_stat = Ladybug_OpenEPWAndSTATWeatherFiles(weatherFileURL=panel)  # -> epwFile, statFile; plug-in component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
analysisperiod = Ladybug_AnalysisPeriod()  # -> readMe, analysisPeriod; plug-in component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
importlocation = Ladybug_ImportLocation(epwFile=epw_stat.epwFile)  # -> location; plug-in component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
sunpath = Ladybug_SunPath(
    north=number_slider,
    location=importlocation,
    hour=12,
    day=21,
    month=12,
    timeStep=1,
    analysisPeriod=analysisperiod.analysisPeriod,
    sunPathScale=Slider(0.2, range=0..1),
    dailyOrAnnualSunPath=True)  # -> readMe, sunVectors, sunAltitudes, sunAzimuths, port, sunSpheresMesh, sunPathCrvs, compassCrvs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; plug-in component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
annual_sun_vectors = Vector(sunpath.sunVectors)
preview = CustomPreview(Geometry=[sunpath.sunPathCrvs, sunpath.compassCrvs], Shader=ColourSwatch(SwatchColor=RGB(38, 44, 59)))

ladybug = Ladybug_Ladybug()  # -> Vviiiiiiiiiizzz; plug-in component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
northarrow = Ladybug_North(north=number_slider, scale=".05")  # -> northSign; plug-in component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

# ---- group: Surfaces with solid materials
brep = Brep(Tree({0}: [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], {0;0}: [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], {1}: [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], {2}: [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], {3}: [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], {4}: [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]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))

# ----
# Sunlight Hours Analysis
panel_2 = Panel(".005")

# ---- group: results visualization / Generate all the hours of the year
series = Series(Start="1", Step=1, Count="8760")

# ----
pt = Point(Point(3, 2.544838682, 0.1224289629))
# Geometry Inputs
comfortmannequin = Ladybug_ComfortMannequin(rotationAngle="175", bodyLocation=pt)  # -> mannequinMesh, legend, legendBasePt; plug-in component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
wires = BrepWireframe(Brep=brep, Density=-1)

# ---- group: Person's face!
item = ListItem(List=comfortmannequin.mannequinMesh, Index=121, Wrap=True)

# ----
preview_2 = CustomPreview(Geometry=item, Shader=ColourSwatch(SwatchColor=RGB(255, 0, 0)))

sunlighthoursanalysis = Ladybug_SunlightHoursAnalysis(
    geometry=flatten(item),
    context=flatten(brep),
    disFromBase=panel_2,
    sunVectors=flatten(annual_sun_vectors),
    timeStep=1,
    parallel=Toggle(True),
    runIt=Toggle(True))  # -> readMe, contextMesh, analysisMesh, testPts, testVec, port, sunlightHoursResult, sunlightHoursMesh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; plug-in component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

# ---- group: results visualization
number_slider_2 = Slider(2, range=0..10)
cull = CullPattern(List=sunpath.sunPositions, CullPattern=sunlighthoursanalysis.sunIsVisible)
cull_2 = CullPattern(List=sunpath.sunPositionsHOY, CullPattern=sunlighthoursanalysis.sunIsVisible)
cull_3 = CullPattern(List=sunpath.sunPositionsInfo, CullPattern=sunlighthoursanalysis.sunIsVisible)
panel_3 = Panel(cull_3)
pt_2 = Point(cull)
day_month_hour_calculator = Ladybug_Day_Month_Hour(HOY=cull_2)  # -> day, month, hour, date; plug-in component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
mindex = MemberIndex(Set=cull_2, Member=series)  # -> Index, Count
lng = ListLength(List=pt_2)
# Result Visualization
preview_3 = CustomPreview(Geometry=pt_2, Shader=ColourSwatch(SwatchColor=RGB(255, 0, 0)))
legendpar = Ladybug_LegendParameters(numSegments="2", fontSize=Slider(0.5, range=0..1))  # -> legendPar; plug-in component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
createheader = Ladybug_CreateLBHeader(location="Philadelphia", dataType="isVisible", units="N/A", timeStep="Hourly", rawData=mindex.Count)  # -> flatten(LBHeader), dataWithHeader; plug-in component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
bnd = Bounds(Numbers=day_month_hour_calculator.hour)
panel_4 = Panel(lng)
panel_5 = Panel(bnd)
number_slider_3 = Slider(0.02, range=0..0.1)
pt_3 = Point(Point(-36.22880975, -6.852742912, 0))
_3dchart = Ladybug_3DChart(
    inputData=flatten(createheader.dataWithHeader),
    basePoint=pt_3,
    xScale=number_slider_3,
    yScale=number_slider_3,
    zScale="0",
    legendPar=legendpar)  # -> readMe, graphMesh, graphCurves, legend, legendBasePts, title, titleBasePts, dataPts, conditionalHOY; plug-in component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
