# Grasshopper definition Remove_Ladybug_and_Honeybee.gh (Grasshopper 0.9.76)
# plug-ins: Python Interpreter

# ---- group: set to true to remove the old version
toggle = BooleanToggle(False)

# ----
removehb = RemoveHB(removeHB=toggle)
# ---------- removehb: Python ----------
import os
import Grasshopper.Folders as folders

ghenv.Component.Name = "RemoveHB"
ghenv.Component.NickName = "RemoveHB"
ghenv.Component.Description = "This component helps you to reomeve old versions of Ladybug and Honeybee"



def removeLBAndHB(target_folder=None):
    if not target_folder:
        UOFolders = folders.ClusterFolders
    else:
        UOFolders = [target_folder]

    for folder in UOFolders: 
        fileNames = os.listdir(folder)
        
        print 'Removing Ladybug + Honeybee!'
        for fileName in fileNames:
            # check for ladybug userObjects and delete the files
            if fileName.StartsWith('Ladybug') or fileName.StartsWith('Honeybee'):
                
                if fileName.StartsWith('LadybugPlus') or fileName.StartsWith('HoneybeePlus'):
                    continue
                
                fullPath = os.path.join(folder, fileName)
                
                if os.path.isdir(fullPath):
                    removeLBAndHB(fullPath)
                
                os.remove(fullPath)

if _removeHB:
    removeLBAndHB()
# ---------- end removehb ----------
