# Grasshopper definition Use_conditional_statement_to_filter_weather_data.gh (Grasshopper 1.0.7)

panel = Panel("https://www.energyplus.net/weather-download/north_and_central_america_wmo_region_4/USA/VA/USA_VA_Arlington-Ronald.Reagan.Washington.Natl.AP.724050_TMY3/all")
ladybug = Ladybug_Ladybug()  # -> Vviiiiiiiiiizzz; plug-in component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
panel_2 = Panel(ladybug)
epw_stat = Ladybug_OpenEPWAndSTATWeatherFiles(weatherFileURL=panel)  # -> epwFile, statFile; plug-in component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
panel_3 = Panel(epw_stat.epwFile)
importepw = Ladybug_ImportEpw(epwFile=epw_stat.epwFile)  # -> readMe, latitude, location, dryBulbTemperature, dewPointTemperature, relativeHumidity, windSpeed, windDirection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; plug-in component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
panel_4 = Panel(importepw.dryBulbTemperature)
# Filter data based on conditional statement
panel_5 = Panel("18 < a < 22 and b < 80")
gradientlibrary = Ladybug_GradientLibrary(gradIndex="8")  # -> customColors; plug-in component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
legendpar = Ladybug_LegendParameters(customColors=flatten(gradientlibrary))  # -> legendPar; plug-in component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
_3dchart = Ladybug_3DChart(
    inputData=flatten([importepw.dryBulbTemperature, importepw.relativeHumidity]),
    xScale=".25",
    zScale="0",
    legendPar=legendpar,
    condStatement=panel_5)  # -> readMe, graphMesh, graphCurves, legend, legendBasePts, title, titleBasePts, dataPts, conditionalHOY; plug-in component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
day_month_hour_calculator = Ladybug_Day_Month_Hour(HOY=_3dchart.conditionalHOY)  # -> day, month, hour, date; plug-in component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
panel_6 = Panel(day_month_hour_calculator.date)
