# Grasshopper definition shadow_range_study.gh (Grasshopper 0.9.76)
# plug-ins: Python Interpreter, Embryo

# 2. Animate
# this slider!
# Right click on the slider and select animate...
# When it is done,
# check C:\shadowStudy\sampleFile\imagesBackup for the images.
number_slider = Slider(6, range=0..6)
# Check for more material types up there.
panel = Panel("orangeBldg")
swatch = ColourSwatch(SwatchColor=RGB(242, 46, 66))
swatch_2 = ColourSwatch(SwatchColor=RGB(255, 255, 255))
ladybug = Ladybug_Ladybug()  # -> Vviiiiiiiiiizzz; plug-in component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
# Materials
honeybee = Honeybee_Honeybee()  # -> Vviiiiiiiiiizzz; plug-in component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
series = Series(Start=9, Step=1, Count=7)
hours = Panel(series)
radopaquematerialbycolor = Honeybee_RadianceOpaqueMaterialByColor(materialName=panel, color=swatch, roughness=0, specularity=0)  # -> avrgRef, RADMaterial; plug-in component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
radopaquematerialbycolor_2 = Honeybee_RadianceOpaqueMaterialByColor(materialName="whiteDiffue", color=swatch_2, roughness=0, specularity=0)  # -> avrgRef, RADMaterial; plug-in component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
item = ListItem(List=series, Index=number_slider, Wrap=True)  # -> simplify(Item)
sky_types = Panel("0")
panel_2 = Panel(ladybug)
panel_3 = Panel(honeybee)
# Sky Definition
# Check for more sky types up there.
# For this example I'm generating a
# standard CIE sky - sunny with sun.
path = FilePath("C:\EnergyPlusV7-2-0\WeatherData\USA_IL_Chicago-OHare.Intl.AP.725300_TMY3.epw")
building_of_interest = Brep(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)
context = Brep([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])
panel_4 = Panel(path)
genstandardciesky = Honeybee_GenerateStandardCIESky(weatherFile=path, month=Slider(12, range=1..12), day=Slider(21, range=1..31), hour=item, skyType=sky_types)  # -> skyFilePath; plug-in component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
wires = BrepWireframe(Brep=context, Density=-1)
preview = CustomPreview(Geometry=building_of_interest, Shader=swatch)
preview_2 = CustomPreview(Geometry=context, Shader=swatch_2)
createhbsrfs = Honeybee_createHBSrfs(geometry=context, RADMaterial=radopaquematerialbycolor_2.RADMaterial)  # -> readMe, simplify(HBSurface); plug-in component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
# Geometry
createhbsrfs_2 = Honeybee_createHBSrfs(geometry=building_of_interest, RADMaterial=radopaquematerialbycolor.RADMaterial)  # -> readMe, simplify(HBSurface); plug-in component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

# ---- group: Change the parameters for a higher quality
radparameters = Honeybee_RADParameters(quality=Slider(1, range=0..1))  # -> readMe, radParameters; plug-in component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

# ---- group: backup the images in the same folder
number_slider_2 = Slider(1, range=0..2)

# ----
# Analysis Recipe!
# For this analysis we want to generate an image!
# That's why I'm putting an image-based recipe together.
imagebasedsimulation = Honeybee_ImageBasedSimulation(skyFile=genstandardciesky, simulationType=2, backupImages=number_slider_2)  # -> analysisRecipe; plug-in component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

# ----
# Make sure you like the current active view
# 1. Set to
# True!
toggle = BooleanToggle(True)

# ----
# Run the Analysis
rundaylightanalysis = Honeybee_RunDaylightSimulation(
    HBObjects=flatten([createhbsrfs.HBSurface, createhbsrfs_2.HBSurface]),
    analysisRecipe=imagebasedsimulation,
    writeRad=toggle,
    runRad=Toggle(True),
    numOfCPUs=Slider(4, range=0..10),
    workingDir="c:\shadowStudy",
    radFileName="sampleFile",
    exportAirWalls=True,
    overwriteResults=True)  # -> readMe, analysisType, resultsUnit, results, testPts, luminance_files, radGeoFile, studyFolder, done; plug-in component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
panel_5 = Panel("c:/shadowStudy/sampleFile/imageBasedSimulation/sampleFile_IMG_Perspective.TIF")
# Convert HDR to GIF
hdr_gif = Honeybee_ConvertHDRToGIF(HDRFilePath=rundaylightanalysis.luminance_files, adjustExposure=Toggle(True))  # -> GIFFilePath; plug-in component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
# Use EmbryoViz!
# You can download it from here:
# http://www.grasshopper3d.com/xn/detail/2985220:Comment:884839
image = ImageFromPath(S=1)
